# Dynamo graph Home.dyn (Dynamo 3.0.0.7186)

integer_slider = IntegerSlider(19, range=0..100 step 1)
integer_slider_2 = IntegerSlider(18, range=0..100 step 1)
rectangularGrid = MycustomNode3.Grids.RectangularGrid(xCount=integer_slider, yCount=integer_slider_2)
watch_3d = Watch3D(rectangularGrid)
